# Grasshopper definition test.gh (Grasshopper 1.0.8)
# plug-ins: RhinoCodePluginGH, Labrador, eleFront, IPMSpatialAnalysis

panel = Panel("G:\My Drive\PHD\Data\IPM\Lattices\MAT")
text = Text(Slider(5, range=1..8))
file_path = FilePath("G:\My Drive\PHD\Data\IPM\High Spatter\MAT")
text_join = TextJoin(Text=[file_path, text], Join="\")
list_files = ListFiles(Folder=text_join, SearchMask="*.csv", recursive=True)
text_split = TextSplit(Text=list_files, Separators="_")
mesh = Mesh([<mesh referenced from the Rhino model> x4221])
number_slider = Slider(0.02, range=0..0.5)
mesh_join = MeshJoin(Meshes=mesh)
createsettings = CreateSettings(VoxelSize=Slider(0.02, range=0.01..0.1), Adaptivity=Slider(0, range=0..1))
list_item = ListItem(List=text_split, Index="1", Wrap=True)  # -> flatten(Item)
createfrommesh = CreateFromMesh(Mesh=mesh_join, Settings=createsettings)
negative = Negative(Value=number_slider)
sort_list = SortList(Keys=list_item, ValuesValuesA=list_files)  # -> Keys, ValuesValuesA
point_read_interval = Slider(10, range=1..20)
multiplication = Multiplication(A=sort_list.Keys, B=Slider(0.05, range=0..0.1))
doubleoffset = DoubleOffset(Volume=createfrommesh, Offset1=number_slider, Offset2=negative, Settings=createsettings)
voxel_size = Slider(0.2, range=0.2..1)
volumetomesh = VolumeToMesh(Volume=doubleoffset)
dom = ConstructDomain(DomainStart=Slider(5, range=0..294), DomainEnd=Slider(294, range=0..294))
disjoint_mesh = DisjointMesh(Mesh=volumetomesh)
subset = SubList(List=sort_list.ValuesValuesA, Domain=dom, Wrap=True)  # -> List, Index
subset_2 = SubList(List=multiplication, Domain=dom, Wrap=True)  # -> List, Index
reread = Button()
voxelisepores = VoxelisePores(PoreMeshes=disjoint_mesh, KClosestPoints=10)
# Create voxel data
voxelisedata = VoxeliseData(
    Input=subset.List,
    XColumnName="GalvoXActualCartesian",
    YColumnName="GalvoYActualCartesian",
    DataColumnName="Photodiode1Normalised",
    LayerHeights=subset_2.List,
    PointReadInterval=point_read_interval,
    VoxelSize=voxel_size,
    Method=0,
    ExtractionRadius=1,
    Reset=reread)
vector_xyz = VectorXYZ(XComponent=Slider(25, range=0..25), YComponent=0, ZComponent=0)  # -> Vector, Length
weightedsumdelegate = WeightedSumDelegate(Weight=Slider(0.5, range=0..1))  # -> out, F; inputs Weight: Double
# ---------- weightedsumdelegate: C# ----------
// Grasshopper Script Instance
#region Usings
using System;
using System.Linq;
using System.Collections;
using System.Collections.Generic;
using System.Drawing;

using Rhino;
using Rhino.Geometry;

using Grasshopper;
using Grasshopper.Kernel;
using Grasshopper.Kernel.Data;
using Grasshopper.Kernel.Types;
#endregion

public class Script_Instance : GH_ScriptInstance
{
    #region Notes
    /* 
      Members:
        RhinoDoc RhinoDocument
        GH_Document GrasshopperDocument
        IGH_Component Component
        int Iteration

      Methods (Virtual & overridable):
        Print(string text)
        Print(string format, params object[] args)
        Reflect(object obj)
        Reflect(object obj, string method_name)
    */
    #endregion

    public static double _weight;
    public static Func<double, double, double> _func;

    private void RunScript(double Weight, ref object F)
    {
        // Write your logic here

        _weight = Weight;
        _func = WeightedSum;

        F = _func;
    }

    static public double WeightedSum(double a, double b)
    {
        return -_weight * a + (1 - _weight) * b;
    }
}
# ---------- end weightedsumdelegate ----------
lower_thresh = Slider(281.21, range=0..390)
# Do some processing
upper_thresh = Slider(390, range=0..390)
construct_domain = ConstructDomain(DomainStart=Slider(1.86, range=0..8.45), DomainEnd=Slider(8.45, range=0..8.45))
move = Move(Geometry=voxelisepores, Motion=vector_xyz.Vector)  # -> Geometry, Transform
spatialcorrelation = SpatialCorrelation(VoxelData=voxelisedata, VoxelRadius=1)
filtervoxels = FilterVoxels(VoxelData=move.Geometry, ScalarRange=construct_domain, RemoveZeros=False, Normalise=False)
dom_2 = ConstructDomain(DomainStart=lower_thresh, DomainEnd=upper_thresh)
panel_2 = Panel("\\wsl.localhost\Ubuntu\home\toby_wilkinson\projects\IPMML\volume.csv")
correlationcoefficients = CorrelationCoefficients(VoxelData2=voxelisepores)  # -> PearsonCoefficient, PearsonP, SpearmanRankCoefficient, SpearmanP
panel_3 = Panel(correlationcoefficients.SpearmanRankCoefficient)
explodevoxels = ExplodeVoxels(VoxelData=filtervoxels)  # -> Voxel_Centres, Voxel_Values, V
dom_3 = ConstructDomain(DomainStart=Slider(0.03, range=0..0.52), DomainEnd=Slider(0.52, range=0..0.52))
bounds = Bounds(Numbers=explodevoxels.Voxel_Values)
readvoxelsfromcsv = ReadVoxelsFromCSV(Filepath=panel_2, VoxelSize=voxel_size)
# Get range of values
explodevoxels_2 = ExplodeVoxels(VoxelData=readvoxelsfromcsv)  # -> VoxelCentres, VoxelIndices, VoxelValues
pdecon = Deconstruct(Point=graft(explodevoxels_2.VoxelIndices))  # -> XComponent, YComponent, ZComponent
bounds_2 = Bounds(Numbers=explodevoxels_2.VoxelValues)
filtervoxels_2 = FilterVoxels(VoxelData=readvoxelsfromcsv, ScalarRange=dom_3, RemoveZeros=False, Normalise=False)
merge = Merge(Data1=pdecon.XComponent, Data2=pdecon.YComponent, Data3=pdecon.ZComponent, Data4=graft(explodevoxels_2.VoxelValues))  # disabled
voxelpreview = VoxelPreview(VoxelData=filtervoxels_2, ScalarRange=bounds_2, PointWeight=5)
voxelpreview_2 = VoxelPreview(VoxelData=filtervoxels, ScalarRange=bounds, PointWeight=5)  # disabled
explodevoxels_3 = ExplodeVoxels(VoxelData=readvoxelsfromcsv)  # -> VoxelCentres, VoxelIndices, VoxelValues; disabled
pshift = ShiftPaths(Data=merge, Offset=Slider(2, range=1..5))
join = TextJoin(Text=pshift, Join=",")  # -> flatten(Result)
ins = InsertItems(List=join, Item="x,y,z,value", Indices=0, Wrap=True)
panel_4 = Panel(ins)
